# Grasshopper definition ghSetup.gh (Grasshopper 1.0.7)
# plug-ins: Kangaroo2 Components

count_dividers = Slider(1000, range=100..1000)
curve = Curve(<curve referenced from the Rhino model>)
divide_curve = DivideCurve(Curve=curve, Count=count_dividers, Kinks=False)  # -> Points, Tangents, Parameters
polyline = PolyLine(Vertices=divide_curve.Points, Closed=Toggle(True))
explode = Explode(Curve=polyline, Recursive=True)  # -> Segments, Vertices
length = Length(Curve=explode.Segments)
number_slider = Slider(1, range=0..1)
average = Average(Input=length)
curve_2 = Curve(<curve referenced from the Rhino model>)
multiplication = Multiplication(A=average, B=Slider(4, range=1..10))
spherecollide = SphereCollide(Points=divide_curve.Points, Radius=multiplication, Strength=number_slider)
length_line = LengthLine(Line=explode.Segments, Length=multiplication, Strength=number_slider)
mesh = Mesh(curve_2)
onmesh = OnMesh(Points=divide_curve.Points, Mesh=mesh, Strength=1)
solver = Solver(GoalObjects=[length_line, spherecollide, onmesh], Reset=Button(), Threshold=1e-15, Tolerance=0.0001, On=Toggle(True))  # -> I, V, O
polyline_2 = PolyLine(Vertices=solver.V, Closed=Toggle(True))
curve_3 = Curve(polyline_2)
